# Grasshopper definition Shiny Materials v3_Hops.gh (Grasshopper 1.0.7)
# plug-ins: Kangaroo2 Components

transparency = Slider(0.291, range=0..1)
msphere = MeshSphere(Base=PlaneXY(0, 0, 0), Radius=10, UCount=10, VCount=20)
mesh_geometry = GetGeometry(msphere, AtLeast=1, AtMost=1, DeleteInput=False, Filter=1074004029, TreeAccess=False)
color_input = GetString(ColourSwatch(SwatchColor=RGB(247, 255, 235)), {"92,140,235"}, selected=[], AtLeast=1, AtMost=1, TreeAccess=False)
reflection_value = GetNumber(
    Slider(0.776, range=0..1),
    {"0.776"}, selected=[],
    AtLeast=1,
    AtMost=1,
    Maximum=1.797693135e+308,
    Minimum=-1.797693135e+308,
    TreeAccess=False)
smoothness_value = GetNumber(
    Slider(0, range=0..1),
    {"0.000"}, selected=[],
    AtLeast=1,
    AtMost=1,
    Maximum=1.797693135e+308,
    Minimum=-1.797693135e+308,
    TreeAccess=False)
transparency_value = GetNumber(
    transparency,
    {"0.291"}, selected=[],
    AtLeast=1,
    AtMost=1,
    Maximum=1.797693135e+308,
    Minimum=-1.797693135e+308,
    TreeAccess=False)
medges = MeshEdges(Mesh=mesh_geometry)  # -> NakedEdges, InteriorEdges, NonManifoldEdges
mp = MultiPipe(Curves=medges.InteriorEdges, NodeSize=0.5, EndOffset=1, StrutSize=1, Segment=0, KinkAngle=0.6, CubeFit=0)
python = GhPythonScript(x=color_input, y=reflection_value, z=smoothness_value, w=transparency_value)  # -> out, a
# ---------- python: Python ----------
__author__ = "soheil.tajik"
__version__ = "2024.11.20"

import Rhino
import System.Drawing

def parse_color(color_input):
    """
    Parse the color input to System.Drawing.Color.
    Input format: 'R,G,B' as a string or already a System.Drawing.Color.
    """
    if isinstance(color_input, str):
        try:
            r, g, b = map(int, color_input.split(','))
            return System.Drawing.Color.FromArgb(r, g, b)
        except Exception as e:
            raise ValueError("Invalid color format. Provide as 'R,G,B'.")
    elif isinstance(color_input, System.Drawing.Color):
        return color_input
    else:
        raise TypeError("Color input must be a string or System.Drawing.Color.")

def main(colour, reflection, smoothness, transparency, env_mat):
    # Parse the input color
    parsed_color = parse_color(colour)

    # Clamp input values between 0 and 1
    reflection = max(0, min(1, reflection))
    smoothness = max(0, min(1, smoothness))
    transparency = max(0, min(1, transparency))

    # Create a Rhino material
    material = Rhino.DocObjects.Material()
    material.DiffuseColor = parsed_color
    material.ReflectionColor = parsed_color
    material.AmbientColor = System.Drawing.Color.Black
    material.EmissionColor = System.Drawing.Color.Black
    material.Reflectivity = reflection
    material.ReflectionGlossiness = smoothness
    material.Transparency = transparency

    # Attempt to set environment texture
    texture_applied = False
    if env_mat and isinstance(env_mat, str):
        try:
            texture = Rhino.Render.Texture(env_mat)
            material.SetEnvironmentTexture(texture)
            texture_applied = True
            print("Environment texture applied successfully.")
        except Exception as e:
            print("Failed to set environment texture. Falling back to color: {}".format(parsed_color))
    
    # Fallback to parsed color if texture wasn't applied
    if not texture_applied:
        material.DiffuseColor = parsed_color
        print("Environment texture not found. Using fallback color: {}".format(parsed_color))

    return material

# Inputs
colour = x  # Input color in format 'R,G,B' as string or System.Drawing.Color
reflection = y  # Input reflectivity as a float
smoothness = z  # Input smoothness as a float
transparency = w  # Input transparency as a float
env_mat = t  # Input environment material as a string (file path)

# Main logic
try:
    output_material = main(colour, reflection, smoothness, transparency, env_mat)
except Exception as error:
    output_material = None
    print("Error: ", error)

# Output the exact color string in 'R,G,B' format
if output_material:
    color = output_material.DiffuseColor
    a = "{},{},{}".format(color.R, color.G, color.B)
else:
    a = None
# ---------- end python ----------
context_bake = ContextBake(Geometry=mp)
context_print = ContextPrint(Text=python.a)
preview = CustomPreview(Geometry=mp, Material=python.a)
